# Dynamo graph placeWallFamily.dyn "placeWallFamilyv1.1" (Dynamo 2.0.2.6826)

# group: CREATE IN REVIT
# note: USED:
# FOR THE CREATION OF ELEMENTS IN THE REVIT WORKSPACE

# group: USER INPUTS
# note: USED:
# FOR USER SELECTIONS, SETTINGS AND GRAPH VARIABLES

# group: GRAPH USAGE NOTES
# note: Graph Version: 1.1
# Dynamo Version: 2.0.2
# Author: Paul Fassnidge
# Date: 31/10/19
# Contact: paulfassnidge@hydrock.com
# Released Notes: Add Level hosting to Families
# Packages required have been prefixed throughout and include:
# Packages used in this script:
# Clockwork for Dynamo 2.x version: 2.1.2
# archi-lab.net version: 2019.2.27
# Graph Instructions:
# IMPORTANT - PLEASE CLOSE AND REOPEN DYNAMO SCRIPT AFTER EACH RUN FOR BEST PERFORMANCE
# 1) If you've installed packages to run this script please close and open Dynamo again prior to running the script.
# 2) Select
# 3) Run graph Automatically or switch to Manual mode and hit 'Run' in bottom left hand corner of screen.

# group: WRITE DATA
# note: USED:
# FOR INSTANCES WHICH CREATE  AND EXPORT DATA TO REVIT OR EXTERNAL SOFTWARES/DIRECTORIES

# group: GET DATA
# note: USED:
# FOR THE DISCOVERY AND RETRIVAL OF INFORMATION

# group: CREATE IN DYNAMO
# note: USED:
# IN CREATION OR ADAPTATION OF GEOMETRY IN THE DYNAMO WORKSPACE

# group: PROCESS DATA
# note: USED:
# AS A GENERAL DEFINITION FOR CASES OF DATA PROCESSING

# group: GRAPH PROCESS COLOR CODING
# note: DYNAMO GRAPHIC STANDARDS APPLIED

# group: Input data
what_level_is_space_room_on = Levels(index=1)  # graph input
select_space_to_add_families_to = DSModelElementSelection()  # 1 picked in the model
select_family_type = FamilyTypes(index=276)  # graph input
number_of_occurances_per_wall = DoubleSlider(3, range=1..10 step 1)  # graph input
vertical_height = DoubleSlider(1227, range=0..3500 step 1)  # graph input

# group: Get Info
getLocation = Element.GetLocation(element=select_space_to_add_families_to)
code_block = CodeBlock { "Name"; }
getParameterValueByName = Element.GetParameterValueByName(element=select_space_to_add_families_to, parameterName=code_block)
code_block_2 = CodeBlock { "Number"; }
getParameterValueByName_2 = Element.GetParameterValueByName(element=select_space_to_add_families_to, parameterName=code_block_2)

# group: Process Data
byLocation = Room.ByLocation(level=what_level_is_space_room_on, location=getLocation, name=getParameterValueByName, number=getParameterValueByName_2)
coreBoundary = Room.CoreBoundary(room=byLocation)
byJoinedCurves = PolyCurve.ByJoinedCurves(curves=coreBoundary)
byGeometry = BoundingBox.ByGeometry(geom=byJoinedCurves)
ZAxis = Vector.ZAxis()
perimeterCurvesByNormal = Custom[Clockwork_BoundingBox.PerimeterCurvesByNormal](boundingbox=byGeometry, normal=ZAxis)  # Returns the perimeter curve of a bounding box on a plane determined by a given normal and the centroid of the bounding box
code_block_3 = CodeBlock(a=number_of_occurances_per_wall) { a + 1; }
pointsAtEqualSegmentLength = Curve.PointsAtEqualSegmentLength(curve=perimeterCurvesByNormal, divisions=code_block_3)

# group: Create Families
byPointAndLevel = FamilyInstance.ByPointAndLevel(familyType=select_family_type, point=pointsAtEqualSegmentLength, level=what_level_is_space_room_on)
code_block_4 = CodeBlock { 1; }
flatten = List.Flatten(list=byPointAndLevel, amt=code_block_4)

# group: Set rotation
code_block_5 = CodeBlock { 0; }
getItemAtIndex = List.GetItemAtIndex(list=flatten, index=code_block_5)
code_block_6 = CodeBlock { 270; }
setRotation = FamilyInstance.SetRotation(familyInstance=getItemAtIndex, degree=code_block_6)

# group: Set rotation
code_block_7 = CodeBlock { 1; }
getItemAtIndex_2 = List.GetItemAtIndex(list=flatten, index=code_block_7)
code_block_8 = CodeBlock { 0; }
setRotation_2 = FamilyInstance.SetRotation(familyInstance=getItemAtIndex_2, degree=code_block_8)

# group: Set rotation
code_block_9 = CodeBlock { 2; }
getItemAtIndex_3 = List.GetItemAtIndex(list=flatten, index=code_block_9)
code_block_10 = CodeBlock { 90; }
setRotation_3 = FamilyInstance.SetRotation(familyInstance=getItemAtIndex_3, degree=code_block_10)

# group: Set rotation
code_block_11 = CodeBlock { 3; }
getItemAtIndex_4 = List.GetItemAtIndex(list=flatten, index=code_block_11)
code_block_12 = CodeBlock { 180; }
setRotation_4 = FamilyInstance.SetRotation(familyInstance=getItemAtIndex_4, degree=code_block_12)

# group: Set Mounting Height
list_create = List.Create(item0=setRotation, item1=setRotation_2, item2=setRotation_3, item3=setRotation_4)
code_block_13 = CodeBlock { "Dimensions_Height_Mounting"; }
setParameterByName = Element.SetParameterByName(element=list_create, parameterName=code_block_13, value=vertical_height)

# group: Remove temporary Room
clockwork_Passthrough = Custom[Clockwork_Passthrough](passThrough=byLocation, waitFor=setParameterByName)  # Forces a sequential order of execution. The node wired into the output of the Passthrough node will be executed *after* the node wired into the waitFor input (e.g. important for some Revit operations). The value of the passThrough input will be passed on to the node wired into the output port of the Passthrough node.
delete = archilab.Revit.Elements.Elements.Delete(element=clockwork_Passthrough)

# group: Data
python_script = Python()  # unwired: IN[0]
# ---------- python_script.python (22 lines) ----------
#BPE data metrics by PF

import clr
import System
from System.IO import Directory

import sys
# load python
pyt_path = r'C:\Program Files (x86)\IronPython 2.7\Lib'
sys.path.append(pyt_path)

from datetime import datetime

project = IN[0]

# get the current date and time
starttime = datetime.now().strftime("%H-%M-%S")

import os
   

OUT = starttime
# ----------------------------------------
control = CodeBlock(passthrough=delete, waitfor=python_script) { [passthrough,waitfor][0]; }
python_script_2 = Python(IN[0]=control)
# ---------- python_script_2.python (35 lines) ----------
#Get project info by PF

import clr
clr.AddReference("RevitServices")
clr.AddReference('DynamoRevitDS')
import RevitServices
from RevitServices.Persistence import DocumentManager

import Dynamo 
import sys
sys.path.append(r'C:\Program Files (x86)\IronPython 2.7\Lib')

import os
DynamoRevit=Dynamo.Applications.DynamoRevit()

passthrough = IN[0]

#Get doc and dynamo stuff
doc = DocumentManager.Instance.CurrentDBDocument
app = DocumentManager.Instance.CurrentUIApplication.Application
scriptname=DynamoRevit.RevitDynamoModel.CurrentWorkspace.FileName

name=os.path.basename(scriptname)

filename,extention=os.path.splitext(name)

elementlist = list()
projinfo = doc.ProjectInformation

elementlist.append(projinfo.Name)
elementlist.append(projinfo.Number)
elementlist.append(app.Username)
elementlist.append(filename)

OUT = elementlist
# ----------------------------------------
control_2 = CodeBlock(seq=python_script_2) { seq[0]; seq[1]; seq[2]; seq[3]; }
python_script_3 = Python(IN[0]=control_2.out0, IN[1]=control_2.out1, IN[2]=control_2.out2, IN[3]=control_2.out3, IN[4]=python_script)
# ---------- python_script_3.python (42 lines) ----------
#BPE data metrics by PF

import clr
import System
from System.IO import Directory

import sys
# load python
pyt_path = r'C:\Program Files (x86)\IronPython 2.7\Lib'
sys.path.append(pyt_path)

from datetime import datetime

project = IN[0]
number = IN[1]
user = IN[2]
scriptname = IN[3]
starttime = IN[4]


# get the current date and time
datestamp = datetime.today().strftime("%Y-%m-%d")
endtime = datetime.now().strftime("%H-%M-%S")

#runtime = (endtime - starttime)
#runtime.seconds

import os

## set the output directory and gather log data
dir = 'Q:\Office\IT Software\Dynamo\data'
   
# create a directory for each user of a machine
Directory.CreateDirectory(dir)

# generate the file name for the log file
filename = (str(datestamp) + '_' +str(endtime) + '_' +str(project) + '_' +str(number) + '_' +str(scriptname) + '_' +str(starttime) + '_' +str(user) + '_' + '.txt')

# create the log file (blank text file)
logger = open(dir + '\\' + filename,'w+')

OUT = str("Run Logged")
# ----------------------------------------
